# Grasshopper definition Linear Contour Interpolation.gh (Grasshopper 1.0.7)

contour_interval = Slider(1, range=0..10)
column_count = Slider(2, range=0..10)
grid_spacing = Slider(41, range=0..100)
row_count = Slider(2, range=0..10)
path = FilePath("C:\Users\Jose\Desktop\Architecture\FUN\contour_heights.txt")
file = ReadFile(File=path, PerLineParse=False)
panel = Panel(file)
initial_coords = GhPythonScript(column_count=column_count, row_count=row_count, contour_interval=grid_spacing, heights=file)  # -> out, points
# ---------- initial_coords: Python ----------
import rhinoscriptsyntax as rs


row_count = int(row_count)
column_count = int(column_count)
contour_step = int(contour_interval)

heights = heights.split("\n")
for height in heights:
    height = float(height)
x_coord = 0
y_coord = 0
i = 0
points = []
for _y in range(0, row_count):
    x_coord = 0
    for _x in range(0, column_count):
        z_coord = float(heights[i])
        points.append(rs.AddPoint(x_coord, y_coord, z_coord))
        i += 1
        x_coord += contour_interval
    y_coord += contour_interval
# ---------- end initial_coords ----------
python = GhPythonScript(heights=file)  # -> out, a
# ---------- python: Python ----------
heights = heights.split("\n")
for i in heights:
    print(i)
# ---------- end python ----------
panel_2 = Panel(initial_coords.points)
clean_data_calculate = GhPythonScript(
    points=panel_2,
    column_count=column_count,
    row_count=row_count,
    contour_interval=contour_interval,
    grid_spacing=grid_spacing)  # -> out, drawn_points, drawn_lines; inputs points: list
# ---------- clean_data_calculate: Python ----------
import rhinoscriptsyntax as rs
import math
import sys
column_count = int(column_count)
row_count = int(row_count)
drawn_points = []
drawn_lines = []
new_points = []
# Take f'd up points list, and convert to proper list of points each with a list of x,y,z coordinates.
def str_to_f(string_list):
    f_list = []
    for item in string_list:
        item = item.strip('{}').split(',')
        f_list.append([float(coord) for coord in item])
    return f_list

points_list = str_to_f(points)

# Takes a list and reshapes it into a matrix increasing from bottom-left to top-right. 
def list_to_matrix(list, column_count, row_count):
    m_list = []
    for x in range(column_count):
        column = []
        for y in range(row_count):
            column.append(list[(x + column_count * y)])
        m_list.append(column)
    return m_list


base_points = list_to_matrix(points_list, column_count, row_count)    

def store_and_draw(point):
    drawn_points.append(rs.AddPoint(point))
    new_points.append(point)
# Calculates new spot elevations and returns 
def calculate_points(base_point, point_b, contour_interval, grid_spacing):
    # Check if two base points are aligned vertically or horizontally. Then calculate slope between base points.
    is_vertical = (base_point[0] == point_b[0])
    elevation_change = point_b[2] - base_point[2]
    slope = elevation_change / grid_spacing
   # Compare with contour interval to check if point should exist.
    if abs(elevation_change) > contour_interval:
        # Find the difference between the lowest contour value and the nearest highest integer.
        ordered_points = sorted([base_point, point_b], key=lambda point: point[2])
        new_contour_count = abs(int(ordered_points[0][2] + 1) - int((ordered_points[1][2]) + 1))
        firstpoint_rise = int(ordered_points[0][2] + 1) - ordered_points[0][2]
        firstpoint_run = firstpoint_rise / slope
        # Store firstpoint coords and then draw.
        run = contour_interval / slope
        if is_vertical:
            firstpoint = [ordered_points[0][0], ordered_points[0][1] + firstpoint_run, ordered_points[0][2] + firstpoint_rise]
            for i in range(new_contour_count - 1):
                nextpoint = [firstpoint[0], firstpoint[1] + ((i + 1) * run), firstpoint[2] + ((i + 1) * contour_interval)]
                store_and_draw(nextpoint)
        else:
            firstpoint = [ordered_points[0][0] + firstpoint_run, ordered_points[0][1], ordered_points[0][2] + firstpoint_rise]
            for i in range(new_contour_count - 1):
                nextpoint = [firstpoint[0] + ((i + 1) * run), firstpoint[1], firstpoint[2] + ((i + 1) * contour_interval)]
                store_and_draw(nextpoint)
        print(firstpoint)
        store_and_draw(firstpoint)
        # drawn_points.append(rs.AddPoint(firstpoint[0], firstpoint[1], firstpoint[2]))
        # Using interpolated point, calculate next points if needed.
    return

# Compares each point with it's surroundings to determine if a new point is needed.
def process_matrix_calc_points(bp, column_count, row_count):
    # Coordinate offsets that can be applied to a point.
    neighbor_check = [(1, 0), (0, 1)]
    # GO through all rows and columns
    for y in range(row_count):
        for x in range(column_count):
            base_point = bp[x][y]
            for dx, dy in neighbor_check:
                nx, ny = x + dx, y + dy
                # Check to see if neighbor point exists within the grid, and if it's not been checked already.
                if 0 <= nx < column_count and 0 <= ny < row_count:
                    # print("BASE POINT: ", base_point, "NEIGHBOR COORDS", bp[nx][ny])
                    neighbor_point = bp[nx][ny]
                    calculate_points(base_point, neighbor_point, contour_interval, grid_spacing)
    return

process_matrix_calc_points(base_points, column_count, row_count)

def draw_line(point_a, point_b):
    print("LINE DRAWN")
    drawn_lines.append(rs.AddLine(point_a, point_b))

def process_matrix_connect_points(bp, column_count, row_count, grid_spacing):
    for y in range(row_count):
        for x in range(column_count):
            if x + 1 < column_count and y + 1 < row_count:
                base_point = bp[x][y]
                # Looking at square with left bottom corner originating from base_point.
                heights_in_square, points_in_square = zip(*[(point[2], point) for point in new_points if base_point[0] <= point[0] <= (base_point[0] + grid_spacing) and base_point[1] <= point[1] <= (base_point[1] + grid_spacing)])
                # points_in_square = [point for point in drawn_points if bp[0] <= point[0] <= (bp[0] + grid_spacing) and bp[1] <= point[1] <= (bp[1] + grid_spacing)]
                # Sorting unique heights_in_square from lowest to highest.
                heights_in_square = sorted(heights_in_square)
                # Repeat once for every unique height within the box.
                for height in set(heights_in_square):
                    b_check = [(1,0), (1,1), (0,1), (0,0)]
                    # If points in square that have same height repeat exactly 2x, then draw line between them)
                    points_same_heights = [point for point in points_in_square if point[2] == height]
                    if len(points_same_heights) == 2:
                        draw_line(points_same_heights[0], points_same_heights[1])
                    # Else begin searching different way.
                    else:
                        # Go through every side of the square.
                        for i in range(4):
                            same_heights = []
                            # For every side, compare next adjacent side. If points with same heights found, store values, then draw lines. 
                            for coord in range(2):
                                if base_point[b_check[i - 1][coord]] < points_same_heights[0][coord] < base_point[b_check[i][coord]]:
                                    same_heights.append(points_same_heights[0][coord])
                            if len(same_heights) == 2:
                                draw_line(same_heights[0], same_heights[1])

process_matrix_connect_points(base_points, column_count, row_count, grid_spacing)
# ---------- end clean_data_calculate ----------
